# Grasshopper definition SiteEval_ExampleFile.gh (Grasshopper 1.0.7)
# plug-ins: Python, Pufferfish

# ---- group: Segmented site boundary curve
crv = Curve(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)
explode = Explode(Curve=crv, Recursive=True)  # -> Segments, Vertices

# ---- group: Site boundary curve as closed curve or segments / DEMs
pt = Point([Point(12.65176811, 35.60193726, 10.31042856), Point(12.66120828, 36.2607336, 10.12595426), Point(13.80598025, 33.68700388, 11.06671587), Point(12.91512472, 34.87882231, 10.58273625), Point(13.4980676, 35.50127855, 10.57197328), Point(13.51305298, 36.48518061, 10.330656)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])

# ---- group: Site boundary curve as closed curve or segments
crv_2 = Curve(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)
sfdemb = SiteFromCurveAndDEMs(Site_curve=crv_2, Dem_pts=pt)  # -> Site_brep, Site_curve; disabled

# ---- group: bldg1
geo = Geometry(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)

# ---- group: bldg2
geo_2 = Geometry(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)

# ---- group: list of bldgs
merge = Merge(Data1=geo, Data2=geo_2)

# ---- group: site geo
geo_3 = Geometry(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)

# ---- group: input site brep/srf (Sample 2) It takes 2min to load unit cells
brep = Brep(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)

# ---- group: Analysis Grid size
number_slider = Slider(1, range=0..10)

# ----
panel = Panel("site 1")

sitewithbldgs = SiteWithBldgs(Site_geo=geo_3, Bldg_geo=merge)  # -> Site_brep, Bldg_geo; disabled

panel_2 = Panel("site 2")
panel_3 = Panel("site 3")

# ---- group: Make sure surface normal is up
flip = Flip(Surface=brep)  # -> Surface, Result

# ---- group: input site brep/srf (Sample 1) It takes 3min to load unit cells
brep_2 = Brep(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)

# ---- group: 3D Contours
_3dcontours = _3DContours(
    site_brep=flip.Surface,
    major_contour_at=Slider(5, range=0..10),
    minor_contour_at=Slider(1, range=0..10),
    tval_major_contours=Slider(0.5, range=0..1),
    tval_minor_contours=Slider(0.3, range=0..1))  # -> Minor_contours, Major_contours, LabelAt_major_contours, Label_major_contours, LabelAt_minor_contours, Label_minor_contours; disabled
tag = TextTag3D(
    Location=_3dcontours.LabelAt_major_contours,
    Text=_3dcontours.Label_major_contours,
    Size=Slider(0.74, range=0..1),
    Justification=7)

# ---- group: Divide surface
unitcells = SrfToUnitCells(Site_brep=flip.Surface, Grid_size=number_slider)  # -> Unit_cells, Data_grid; disabled

# ---- group: Hydrology / Cell Flow Direction
unitcellflow = UnitCellFlow(Unit_cells=unitcells.Unit_cells)  # -> Endspots, Cell_flow_dir, Centroid; disabled
vdis = VectorDisplay(Anchor=unitcellflow.Endspots, Vector=unitcellflow.Cell_flow_dir)

# ---- group: Hydrology / Flow Paths
flowpaths = FlowPaths(Site_brep=flip.Surface, Unit_cells=unitcells.Unit_cells)  # -> Endpts, Stagpts, Flowpaths; disabled

# ---- group: Compute Slope and elevations
slopendems = ComputeSlopenDEMs(Unit_cells=unitcells.Unit_cells)  # -> Unit_cells, Spots, Spot_slope_deg, Spot_elevation, Spot_ele_cols; disabled

# ----
swatch = ColourSwatch(SwatchColor=RGB(0, 0, 0))
roundd = RoundToDecimalPlace(NumberX=slopendems.Spot_elevation, DecimalPlace=Slider(2, range=0..10), RoundType=0)  # -> Rounded, Difference

# ---- group: label elevation at spot
tag_2 = TextTag3D(Location=slopendems.Spots, Text=roundd.Rounded, Size=Slider(0.25, range=0..1), Colour=swatch, Justification=7)

# ---- group: connect stagpts
pt_2 = Point(flowpaths.Stagpts)
dots = DotDisplay(Point=pt_2, Colour=ColourSwatch(SwatchColor=RGB(96, 63, 242)), Size=Slider(0.2, range=0..1))

# ---- group: label slope at spot
tag_3 = TextTag3D(Location=slopendems.Spots, Text=roundd.Rounded, Size=Slider(0.25, range=0..1), Colour=swatch, Justification=7)

# ---- group: connect flow path crvs
crv_3 = Curve(flowpaths.Flowpaths)
preview = CustomPreview(Geometry=crv_3, Material=ColourSwatch(SwatchColor=RGB(37, 0, 204)))

# ---- group: Site Visualization
preview_2 = CustomPreview(Geometry=flip.Surface, Material=ColourSwatch(SwatchColor=RGB(59, 217, 93)))

# ---- group: 2D Contours
_2dcontours = _2DContours(
    Site_brep=flip.Surface,
    LabelAt_minor_contours=_3dcontours.LabelAt_minor_contours,
    Minor_contours=_3dcontours.Minor_contours,
    LabelAt_major_contours=_3dcontours.LabelAt_major_contours,
    Major_contours=_3dcontours.Major_contours)  # -> Site_hor, Minor_contours_hor, LabelAt_minor_contours_hor, Major_contours_hor, LabelAt_major_contours_hor; disabled

# ---- group: connect endpts
pt_3 = Point(flowpaths.Endpts)
dots_2 = DotDisplay(Point=pt_3, Colour=ColourSwatch(SwatchColor=RGB(255, 0, 0)), Size=Slider(0.2, range=0..1))

# ---- group: Visualize site elevation
preview_3 = CustomPreview(Geometry=slopendems.Unit_cells, Material=slopendems.Spot_ele_cols)

# ---- group: Minor
tag_4 = TextTag3D(
    Location=_2dcontours.LabelAt_minor_contours_hor,
    Text=_3dcontours.Label_minor_contours,
    Size=Slider(0.74, range=0..1),
    Justification=7)

# ---- group: Major
tag_5 = TextTag3D(
    Location=_2dcontours.LabelAt_major_contours_hor,
    Text=_3dcontours.Label_major_contours,
    Size=Slider(0.74, range=0..1),
    Justification=7)

# ---- group: Visualize Slope degree
visdegslope = VisulaizeDegreeSlope(Site_brep=flip.Surface, Unit_cells=slopendems.Unit_cells, Spot_slope_deg=slopendems.Spot_slope_deg)  # -> Col_legend, Doms, Cols, Site_srf_area, Site_hor_area; disabled

# ---- group: legend
rec = Rectangle({Plane=PlaneXY(8.5, 2.5, 0), Size=Domain2(u=-0.5..0.5, v=-2.5..2.5)})
legend = Legend(Colour=visdegslope.Col_legend, Tags=visdegslope.Doms, Rectangle=rec, LegendType=1)

# ---- group: visualize degree of slope
preview_4 = CustomPreview(Geometry=slopendems.Unit_cells, Material=visdegslope.Cols)

# ---- group: Site area calculation
panel_4 = Panel(visdegslope.Site_srf_area)
panel_5 = Panel(visdegslope.Site_hor_area)
